# Grasshopper definition ParametricVase.gh (Grasshopper 1.0.7)
# plug-ins: Kangaroo Components

height = Slider(12, range=0..20)
folds_vertical = Slider(22, range=0..100)
folds_vertical_2 = GetNumber(folds_vertical, AtLeast=1, AtMost=1, Maximum=1.797693135e+308, Minimum=-1.797693135e+308)
clean = CombineClean(Meshes=<missing>)
height_2 = GetNumber(height, AtLeast=1, AtMost=1, Maximum=1.797693135e+308, Minimum=-1.797693135e+308, Prompt="height")
width = Slider(42, range=0..100)
smoothness = Slider(12, range=0..20)
pt = ConstructPoint(XCoordinate=0, YCoordinate=0, ZCoordinate=0)
folds_horizontal = Slider(14, range=0..20)
range = Range(Domain=Domain(0, 1), Steps=folds_vertical_2)
line = LineSDL(Start=pt, Direction=Vector(0, 0, 1), Length=height_2)
width_2 = GetNumber(width, AtLeast=1, AtMost=1, Maximum=1.797693135e+308, Minimum=-1.797693135e+308)
graph = GraphMapper(
    range,
    x0=0,
    x1=1,
    y0=0,
    y1=1,
    container_name="Bezier",
    cpx=[0, 0.2797033191, 0.7273545861, 1],
    cpy=[0.04292535782, 0.04453122616, 0.2142062783, 0.03994953632])
smoothness_2 = GetNumber(smoothness, AtLeast=1, AtMost=1, Maximum=1.797693135e+308, Minimum=-1.797693135e+308)
divide = DivideCurve(Curve=line, Count=folds_vertical_2, Kinks=False)  # -> Points, Tangents, Parameters
folds_horizontal_2 = GetNumber(folds_horizontal, AtLeast=1, AtMost=1, Maximum=1.797693135e+308, Minimum=-1.797693135e+308)
multiplication = Multiplication(A=graph, B=smoothness_2)
multiplication_2 = Multiplication(A=graph, B=width_2)
circle = CircleCNR(Center=divide.Points, Normal=Vector(0, 0, 1), Radius=multiplication_2)
seam = Seam(Curve=reparameterize(circle), Seam=multiplication)
depth_folding = Slider(0.15, range=0..1)
series = Series(Start=0, Step=1, Count=folds_horizontal_2)
divide_2 = DivideCurve(Curve=seam, Count=folds_horizontal_2, Kinks=False)  # -> Points, Tangents, Parameters
series_2 = Series(Start=0, Step=folds_horizontal_2, Count=folds_vertical_2)
depth_folding_2 = GetNumber(depth_folding, AtLeast=1, AtMost=1, Maximum=1.797693135e+308, Minimum=-1.797693135e+308)
dispatch = Dispatch(List=divide_2.Points, DispatchPattern=[True, False])  # -> ListA, ListB
shift = ShiftList(List=series, Shift=1, Wrap=True)
vec2pt = Vector2Pt(PointA=dispatch.ListB, PointB=graft(divide.Points), Unitize=False)  # -> Vector, Length
series_3 = Series(Start=series_2, Step=1, Count=folds_horizontal_2)
multiplication_3 = Multiplication(A=vec2pt.Vector, B=depth_folding_2)
move = Move(Geometry=dispatch.ListB, Motion=multiplication_3)  # -> Geometry, Transform
weave = Weave(Pattern=[0, 1], Stream0=dispatch.ListA, Stream1=move.Geometry, NullGaps=False)
shift_2 = ShiftList(List=series_3, Shift=1, Wrap=True)
addition = Addition(A=shift_2, B=folds_horizontal_2)
addition_2 = Addition(A=series_3, B=folds_horizontal_2)
flatten = FlattenTree(Tree=weave, Path="{0}")
lng = ListLength(List=flatten)
triangle = MeshTriangle(CornerA=series, CornerB=lng, CornerC=shift)
quad = MeshQuad(CornerA=series_3, CornerB=shift_2, CornerC=addition, CornerD=addition_2)
merge = Merge(Data1=flatten, Data2=pt)
merge_2 = Merge(Data1=quad, Data2=triangle)
conmesh = ConstructMesh(Vertices=merge, Faces=flatten(merge_2))
